# Grasshopper definition MocapDemo-garthz.gh (Grasshopper 0.9.76)
# plug-ins: Python Interpreter, Firefly.X

# ----
# Mocap Stream Receiver
# Construct coordinate axes for each object
# from the origin point and  unit basis vectors.
# 
# Note that these have been rotated from
# Optitrack XZ ground plane conventions to
# Rhino XY ground plane conventions.
timer = Timer(TimerInterval=20, Target=python)
python = PythonScript(reset=Toggle(False), version="2900")  # -> out, received, position, orient, xaxis, yaxis; inputs reset: Boolean
# ---------- python: Python ----------
# demo_receiver.py - the motion capture script in the ghpython object in MocapDemo.gh
#
# Demonstration of receiving and parsing an Optitrack motion capture real-time stream.
# This is normally polled from a timer.
#
# inputs
#   reset   - Boolean flag to reset the receiver system
#   version - string defining the protocol version number (e.g. "2900" for Motive 1.9)
#
# outputs
#   out      - debugging text stream
#   received - flag true if new data was received
#   position - data tree of position tuples
#   orient   - data tree of quaternion tuples, orientations are (x,y,z,w) quaternions
#   xaxis    - data tree of X axis unit vectors (computed from orientations)
#   yaxis    - data tree of Y axis unit vectors (computed from orientations)

# use persistent state context
import scriptcontext

# import the Optitrack stream receiver
import optirecv

# If the user reset input is set, then clear any existing state and do nothing.
if reset:
    print "Resetting receiver state."
    scriptcontext.sticky['mocap_port'] = None
 
else:
   # fetch or create the persistent motion capture streaming receiver port
    port = scriptcontext.sticky.get('mocap_port')
    if port is None:
        port = optirecv.OptitrackReceiver(version)
        scriptcontext.sticky['mocap_port'] = port
    
    received = True
    while received:
        received = port.poll()
        
    # always set the output variables so the most recent values are available
    position, orient, xaxis, yaxis = port.make_data_trees()
# ---------- end python ----------
panel = Panel(python.out)
panel_2 = Panel(python.received)
pt = Point(python.yaxis)
pt_2 = Point(python.xaxis)
pt_3 = Point(python.position)
bool = Boolean(python.received)
panel_3 = Panel(python.position)
addition = Addition(A=pt_3, B=pt_2)
addition_2 = Addition(A=pt_3, B=pt)
ln = Line(StartPoint=pt_3, EndPoint=addition)
ln_2 = Line(StartPoint=pt_3, EndPoint=addition_2)

# ----
# Mocap CSV File Loader
# Note: the Mocap CSV loader rotates
# the input data from the XZ ground plane
# convention of the Optitrack system
# to a XY Rhino ground plane convention.
# Length of axes
path = FilePath("C:\Users\garthz\Rhino\HMV-S16\MocapDemo\Take 2016-01-19 12.25.04 AM.csv")
panel_4 = Panel(path)
python_2 = PythonScript(path=panel_4)  # -> out, names, position, xaxis, yaxis
# ---------- python_2: Python ----------
# demo_reader.py - the file loader script in the ghpython object in MocapDemo.gh.

# Demonstration of parsing an Optitrack motion capture CSV file.
#
# inputs
#   path    - string with the full path to the CSV file
#
# outputs
#   out      - debugging text stream
#   names    - data tree of body names
#   position - data tree of position tuples
#   xaxis    - data tree of X axis unit vectors (computed from orientations)
#   yaxis    - data tree of Y axis unit vectors (computed from orientations)


# import the Optitrack file loader from the same folder
import optiload

# load the file
take = optiload.load_csv_file(path)

print "Found rigid bodies:", take.rigid_bodies.keys()

# emit all return values
names = take.rigid_bodies.keys()
position, xaxis, yaxis = optiload.make_data_trees(take)
# ---------- end python_2 ----------
number_slider = Slider(0.2, range=0..1)
panel_5 = Panel(python_2.out)
panel_6 = Panel(python_2.names)
# Note: it appears my CSV parser is creating a two-level tree with lists in the branches.  The first branch is singular; the second branch is per rigid body; the leaf is a list of point.
panel_7 = Panel(python_2.yaxis)
panel_8 = Panel(python_2.xaxis)
multiplication = Multiplication(A=python_2.xaxis, B=number_slider)
multiplication_2 = Multiplication(A=python_2.yaxis, B=number_slider)
panel_9 = Panel(python_2.position)
addition_3 = Addition(A=python_2.position, B=multiplication_2)
addition_4 = Addition(A=python_2.position, B=multiplication)
pt_4 = Point(python_2.position)
ln_3 = Line(StartPoint=pt_4, EndPoint=addition_4)
ln_4 = Line(StartPoint=pt_4, EndPoint=addition_3)

rigid_body = Slider(0, range=0..4)
merge = Merge(Data1="0", Data2=rigid_body)
button = Button()
path_2 = ConstructPath(Indices=merge)
timer_2 = Timer(TimerInterval=20, Target=counter)
enable_playback = BooleanToggle(True)
rewind_playback = Button()
branch = TreeBranch(Tree=pt_4, Path=path_2, MaintainPaths=False)
branch_2 = TreeBranch(Tree=python_2.yaxis, Path=path_2, MaintainPaths=False)
branch_3 = TreeBranch(Tree=python_2.xaxis, Path=path_2, MaintainPaths=False)
lng = ListLength(List=branch)
counter = Counter(CountDirection=True, Step=1, StartStop=enable_playback, Reset=rewind_playback, OptionalCounterDomain=lng)
panel_10 = Panel(branch)
branch_4 = TreeBranch(Tree=branch, Path=Slider(0, range=0..100), MaintainPaths=False)
item = ListItem(List=branch, Index=counter, Wrap=True)
item_2 = ListItem(List=branch_3, Index=counter, Wrap=True)
item_3 = ListItem(List=branch_2, Index=counter, Wrap=True)
panel_11 = Panel(counter)
panel_12 = Panel(branch_4)
panel_13 = Panel(item)
addition_5 = Addition(A=item, B=item_3)
addition_6 = Addition(A=item, B=item_2)
ln_5 = Line(StartPoint=item, EndPoint=addition_6)
ln_6 = Line(StartPoint=item, EndPoint=addition_5)
pt_5 = Point(Point(4, 11, 3))
pt_6 = Point(Point(-4, -7, 0))
capture = Button()
erase = Button()
box = Box2Pt(PointA=pt_5, PointB=pt_6, Plane=PlaneXY(0, 0, 0))
# Note: the counter is continuously polled
#  and so this will record multiple planes
# per capture click.  I.e., the switch isn't debounced yet,
# and the timer is free-running.
pl_3pt = Plane3Pt(PointA=item, PointB=addition_6, PointC=addition_5)
python_3 = PythonScript(input=pl_3pt, capture=capture, clear=erase)  # -> out, planes; inputs input: Plane, capture: Boolean, clear: Boolean
# ---------- python_3: Python ----------
# demo_plane_recorder.py - the plane data recording script in the ghpython object in MocapDemo.gh.
#
# inputs
#  input    - single Plane object
#  capture  - Boolean indicating the object should be added to the set
#  clear    - Boolean indicating the the data set should be erased

# other ideas:
#   path       - string with the full path to the CSV file
#   selection  - currently selected set

# outputs
#   out      - debugging text stream
#   planes   - list of Plane objects

# use RhinoCommon API
import Rhino

# use persistent state context
import scriptcontext

################################################################
class PlaneRecorder(object):
    def __init__(self):
        self.planes = []
        return

    def add_plane(self, plane):
        self.planes.append(plane)
        return

################################################################
if clear:
    # create an empty data recorder
    recorder = PlaneRecorder()
    scriptcontext.sticky['plane_recorder'] = recorder

else:
    # fetch or create a persistent data recorder
    recorder = scriptcontext.sticky.get('plane_recorder')
    if recorder is None:
        recorder = PlaneRecorder()
        scriptcontext.sticky['plane_recorder'] = recorder

if capture:
    recorder.add_plane(input)

planes = recorder.planes
print "Currently holding %d planes." % len(planes)
# ---------- end python_3 ----------
pln = Plane(python_3.planes)
panel_14 = Panel(python_3.out)
